# Grasshopper definition prsmatic_joints.gh (Grasshopper 1.0.8)

block_height = Slider(0, range=0..100)
block_length = Slider(25, range=0..100)
block_width = Slider(25, range=0..100)
teeth_width = Slider(2, range=0..10)
teeth_length = Slider(13, range=0..100)
sine = Sine(Value=Slider(45, range=0..360))
rotation_degrees = Slider(225, range=0..360)
origin = ConstructPoint(XCoordinate=0, YCoordinate=0, ZCoordinate=0)
ur_rect_point = ConstructPoint(XCoordinate=block_width, YCoordinate=block_length, ZCoordinate=0)
origin_2 = ConstructPoint(XCoordinate=0, YCoordinate=0, ZCoordinate=0)
ur_rect_point_2 = ConstructPoint(XCoordinate=teeth_width, YCoordinate=teeth_length, ZCoordinate=0)
tooth_x_movement = Slider(4, range=0..100)
multiplication = Multiplication(A=teeth_width, B=sine)
block_rect = Rectangle2Pt(Plane=PlaneXY(0, 0, 0), PointA=origin, PointB=ur_rect_point, Radius=0)  # -> Rectangle, Length
teeth_rect = Rectangle2Pt(Plane=PlaneXY(0, 0, 0), PointA=origin_2, PointB=ur_rect_point_2, Radius=0)  # -> Rectangle, Length
radians = Radians(Degrees=rotation_degrees)
vector_xyz = VectorXYZ(XComponent=tooth_x_movement, YComponent=multiplication, ZComponent=0)  # -> Vector, Length
vector_xyz_2 = VectorXYZ(XComponent=block_width, YComponent=Slider(11, range=0..25), ZComponent=0)  # -> Vector, Length
rotate = Rotate(Geometry=teeth_rect.Rectangle, Angle=radians, Plane=PlaneXY(0, 0, 0))  # -> Geometry, Transform
teeth_offset = Slider(0.25, range=0..1)
move = Move(Geometry=rotate.Geometry, Motion=vector_xyz.Vector)  # -> Geometry, Transform
move_2 = Move(Geometry=rotate.Geometry, Motion=vector_xyz_2.Vector)  # -> Geometry, Transform
offset_curve = OffsetCurve(Curve=[move.Geometry, move_2.Geometry], Distance=teeth_offset, Corners=1)
vector_xyz_3 = VectorXYZ(XComponent=Slider(0, range=0..25), YComponent=Slider(25, range=0..25), ZComponent=0)  # -> Vector, Length
printable_block = SolidUnion(Breps=[move.Geometry, block_rect.Rectangle, move_2.Geometry])
offset_block = SolidUnion(Breps=[offset_curve, block_rect.Rectangle])
height = Slider(5, range=0..20)
move_3 = Move(Geometry=offset_block, Motion=vector_xyz_3.Vector)  # -> Geometry, Transform
mirror = Mirror(Geometry=move_3.Geometry, Plane=PlaneYZ(0, 0, 0))  # -> Geometry, Transform
unit_z = UnitZ(Factor=height)
vector_xyz_4 = VectorXYZ(XComponent=Slider(50, range=0..75), YComponent=Slider(-12.5, range=-75..75), ZComponent=0)  # -> Vector, Length
extrude = Extrude(Base=printable_block, Direction=unit_z)
move_4 = Move(Geometry=mirror.Geometry, Motion=vector_xyz_4.Vector)  # -> Geometry, Transform
extrude_2 = Extrude(Base=[move_4.Geometry, move_3.Geometry], Direction=unit_z)
solid_difference = SolidDifference(BrepsA=extrude)
