# Grasshopper definition resolute_2d_joint.gh (Grasshopper 1.0.8)
# plug-ins: Pancake

ur_block_x_spacing = Slider(2, range=-10..10)
middle_piece_y_spacing = Slider(-16, range=-50..50)
middle_piece_x_spacing = Slider(30, range=0..100)
total_middle_pieces = Slider(5, range=1..11)
tooth_arc_degrees = Slider(75, range=0..360)
block_height = Slider(8, range=0..100)
block_length = Slider(20, range=0..100)
tooth_offset = Slider(0.25, range=0..1)
block_width = Slider(20, range=0..100)
right_tooth_y_offset = Slider(1.15, range=-10..10)
bottom_tooth_x_offset = Slider(1, range=-10..10)
tooth_width = Slider(2.068, range=0..20)
tooth_length = Slider(5.941, range=0..20)
origin = ConstructPoint(XCoordinate=0, YCoordinate=0, ZCoordinate=0)
rect_ur = ConstructPoint(XCoordinate=tooth_width, YCoordinate=tooth_length, ZCoordinate=0)
radians = Radians(Degrees=tooth_arc_degrees)
origin_2 = ConstructPoint(XCoordinate=0, YCoordinate=0, ZCoordinate=0)
rect_ur_2 = ConstructPoint(XCoordinate=block_width, YCoordinate=block_length, ZCoordinate=0)
tooth_box = Box2Pt(PointA=origin, PointB=rect_ur, Plane=PlaneXY(0, 0, 0))
reference_tooth_arc = Arc(Plane=PlaneXY(0, 0, 0), Radius=tooth_length, Angle=radians)  # -> Arc, Length
block_rect = Rectangle2Pt(Plane=PlaneXY(0, 0, 0), PointA=origin_2, PointB=rect_ur_2, Radius=0)  # -> Rectangle, Length
tooth_rect_ur = ConstructPoint(XCoordinate=0, YCoordinate=tooth_length, ZCoordinate=0)
right_rotation_sub = Subtraction(A=90, B=tooth_arc_degrees)
block_surface = Surface(block_rect.Rectangle)
bottom_rotation_sub = Subtraction(A=360, B=tooth_arc_degrees)
rotation_radians = Radians(Degrees=right_rotation_sub)
base_line = Line(StartPoint=origin, EndPoint=tooth_rect_ur)
tooth_y_vector = VectorXYZ(XComponent=block_width, YComponent=right_tooth_y_offset, ZComponent=0)  # -> Vector, Length
radians_2 = Radians(Degrees=bottom_rotation_sub)
tooth_arc_flow = Flow(
    Geometry=tooth_box,
    Base=base_line,
    Target=reference_tooth_arc.Arc,
    ReverseBase=False,
    ReverseTarget=False,
    Stretch=True,
    Rigid=False)
multiplication = Multiplication(A=block_width, B=2)
tooth_x_vector = VectorXYZ(XComponent=bottom_tooth_x_offset, YComponent=0, ZComponent=0)  # -> Vector, Length
right_tooth_rotation = Rotate(Geometry=tooth_arc_flow, Angle=rotation_radians, Plane=PlaneXY(0, 0, 0))  # -> Geometry, Transform
left_tooth_rotation = Rotate(Geometry=tooth_arc_flow, Angle=radians_2, Plane=PlaneXY(0, 0, 0))  # -> Geometry, Transform
right_tooth_y_move = Move(Geometry=right_tooth_rotation.Geometry, Motion=tooth_y_vector.Vector)  # -> Geometry, Transform
left_tooth_y_move = Move(Geometry=left_tooth_rotation.Geometry, Motion=tooth_x_vector.Vector)  # -> Geometry, Transform
top_left_block = Brep([right_tooth_y_move.Geometry, block_surface, left_tooth_y_move.Geometry])
unit_z = UnitZ(Factor=block_height)
panel = Panel("Multiplication")
tooth_offset_2 = OffsetCurve(Curve=[right_tooth_y_move.Geometry, left_tooth_y_move.Geometry], Distance=tooth_offset, Corners=1)
block_surface_with_tooth_offset = Surface(tooth_offset_2)
top_left_block_with_offset = Brep([block_surface_with_tooth_offset, block_surface])
unit_x = UnitX(Factor=1)
block = Extrude(Base=top_left_block, Direction=unit_z)
multiplication_2 = Multiplication(A=block_length, B=-1)
multiplication_3 = Multiplication(A=block_length, B=-1)
block_with_offset = Extrude(Base=top_left_block_with_offset, Direction=unit_z)  # -> flatten(Extrusion)
multiplication_4 = Multiplication(A=block_length, B=-1)
halve = Division(A=total_middle_pieces, B=2)
block_2 = Extrude(Base=block_surface, Direction=unit_z)
list_item = ListItem(List=block, Index=0, Wrap=True)
unit_y = UnitY(Factor=multiplication_2)
unit_y_2 = UnitY(Factor=multiplication_3)
unit_y_3 = UnitY(Factor=multiplication_4)
division = Division(A=block_length, B=-2)
mirror = Mirror(Geometry=block_with_offset, Plane=PlaneYZ(0, 0, 0))  # -> Geometry, Transform
move = Move(Geometry=block, Motion=unit_y)  # -> Geometry, Transform
brep = Brep(list_item)
mirror_2 = Mirror(Geometry=block, Plane=PlaneYZ(0, 0, 0))  # -> Geometry, Transform
vector_xyz = VectorXYZ(XComponent=multiplication, YComponent=division, ZComponent=0)  # -> Vector, Length
move_2 = Move(Geometry=block_2, Motion=unit_y_2)  # -> Geometry, Transform
move_3 = Move(Geometry=brep, Motion=unit_y_3)  # -> Geometry, Transform
round = Round(Number=halve)  # -> Nearest, RightPieceCountFloor, LeftPieceCountCeiling
move_4 = Move(Geometry=mirror.Geometry, Motion=vector_xyz.Vector)  # -> Geometry, Transform
move_5 = Move(Geometry=mirror_2.Geometry, Motion=vector_xyz.Vector)  # -> Geometry, Transform
top_right_block_without_subtract = Extrude(Base=move_4.Geometry, Direction=unit_z)
top_right_block_without_subtract_2 = Extrude(Base=move_5.Geometry, Direction=unit_z)
number = Number(-1)
number_2 = Number(-1)
middle_piece_spacing_offsets = Series(Start=0, Step=middle_piece_x_spacing, Count=total_middle_pieces)
multiplication_5 = Multiplication(A=round.LeftPieceCountCeiling, B=number)
multiplication_6 = Multiplication(A=total_middle_pieces, B=number_2)
middle_piece_solid_difference = SolidDifference(BrepsA=move.Geometry, BrepsB=[top_right_block_without_subtract, block_with_offset])  # -> graft(Result)
multiplication_7 = Multiplication(A=block_length, B=-1)
construct_point = ConstructPoint(XCoordinate=Slider(40, range=0..100), YCoordinate=Slider(-50, range=-50..50), ZCoordinate=0)
solid_difference = SolidDifference(BrepsA=top_right_block_without_subtract_2, BrepsB=block_with_offset)
solid_intersection = SolidIntersection(BrepsA=move_2.Geometry, BrepsB=[middle_piece_solid_difference, solid_difference])  # -> flatten(Result)
construct_point_2 = ConstructPoint(XCoordinate=Slider(0, range=0..100), YCoordinate=Slider(-50, range=-50..50), ZCoordinate=0)
multiplication_8 = Multiplication(A=block_length, B=multiplication_5)
spacing_vectors = ConstructPoint(XCoordinate=middle_piece_spacing_offsets, YCoordinate=middle_piece_y_spacing, ZCoordinate=0)
multiplication_9 = Multiplication(A=block_length, B=multiplication_6)
negative = Negative(Value=block_length)
move_6 = Move(Geometry=solid_intersection, Motion=construct_point)  # -> Geometry, Transform
move_7 = Move(Geometry=[solid_intersection, move_3.Geometry], Motion=construct_point_2)  # -> Geometry, Transform
middle_piece_spacing_move = Move(Geometry=middle_piece_solid_difference, Motion=spacing_vectors)  # -> Geometry, Transform
division_2 = Division(A=block_length, B=2)
multiplication_10 = Multiplication(A=round.RightPieceCountFloor, B=block_length)
negative_2 = Negative(Value=block_width)
division_3 = Division(A=negative, B=2)
construct_point_3 = ConstructPoint(XCoordinate=0, YCoordinate=multiplication_8, ZCoordinate=0)
mirror_3 = Mirror(Geometry=solid_difference, Plane=PlaneYZ(0, 0, 0))  # -> Geometry, Transform
construct_point_4 = ConstructPoint(XCoordinate=block_width, YCoordinate=multiplication_9, ZCoordinate=0)
final_middle_pieces = Brep(flatten(middle_piece_spacing_move.Geometry))
unit_x_2 = UnitX(Factor=ur_block_x_spacing)
middle_piece = Brep(middle_piece_solid_difference)
addition = Addition(A=division_2, B=multiplication_10)
series = Series(Start=0, Step=negative_2, Count=round.LeftPieceCountCeiling)
series_2 = Series(Start=division_3, Step=multiplication_7, Count=round.RightPieceCountFloor)
move_8 = Move(Geometry=solid_intersection, Motion=construct_point_3)  # -> Geometry, Transform
bl_and_br_final_pieces = Brep([move_7.Geometry, move_6.Geometry])
multiplication_11 = Multiplication(A=block_width, B=2)
move_9 = Move(Geometry=mirror_3.Geometry, Motion=unit_x_2)  # -> Geometry, Transform
move_10 = Move(Geometry=solid_intersection, Motion=construct_point_4)  # -> Geometry, Transform
negative_3 = Negative(Value=addition)
final_flipped_ur_block = Brep(move_9.Geometry)
bl_piece = Brep(move_8.Geometry)
final_ul_block = Brep(block)
construct_point_5 = ConstructPoint(XCoordinate=0, YCoordinate=series, ZCoordinate=0)
construct_point_6 = ConstructPoint(XCoordinate=multiplication_11, YCoordinate=series_2, ZCoordinate=0)
export_file_name = Panel("/Users/mattzago/Desktop/test1.stl")
construct_point_7 = ConstructPoint(XCoordinate=multiplication_11, YCoordinate=negative_3, ZCoordinate=0)
move_11 = Move(Geometry=middle_piece, Motion=construct_point_5)  # -> Geometry, Transform
overwrite_toggle = BooleanToggle(True)
export_button = TrueOnlyButton(LastSaveLocalization="neutral,N")
mirror_4 = Mirror(Geometry=[solid_intersection, move_3.Geometry], Plane=PlaneYZ(0, 0, 0))  # -> Geometry, Transform
mirror_5 = Mirror(Geometry=middle_piece, Plane=PlaneYZ(0, 0, 0))  # -> Geometry, Transform
final_brep_preview = Brep([final_flipped_ur_block, bl_and_br_final_pieces, final_ul_block, final_middle_pieces])
left_stacked_pieces = Brep(move_11.Geometry)
vector_xyz_2 = VectorXYZ(XComponent=Slider(40, range=0..100), YComponent=Slider(-10, range=-100..100), ZComponent=0)  # -> Vector, Length
stl_export_line_blocks = ExportAs(
    Geometry=final_brep_preview,
    FileLocation=export_file_name,
    Overwrite=overwrite_toggle,
    Export=export_button,
    CompMode=False,
    LastSaveLocalization="neutral,N")  # -> OK, ExportCommand
move_12 = Move(Geometry=mirror_5.Geometry, Motion=construct_point_6)  # -> Geometry, Transform
move_13 = Move(Geometry=mirror_4.Geometry, Motion=construct_point_7)  # -> Geometry, Transform
move_14 = Move(Motion=vector_xyz_2.Vector)  # -> Geometry, Transform
br_piece = Brep(move_13.Geometry)
right_stacked_pieces = Brep(move_12.Geometry)
lined_up_blocks_brep = Brep([left_stacked_pieces, right_stacked_pieces, br_piece, bl_piece, solid_difference, block])
line = Line(StartPoint=Point(19.54403474, -70.01307714, 0), EndPoint=Point(20.35680073, 19.93302623, 0))
curve = Curve(<curve referenced from the Rhino model>)
arc = Arc(Plane=PlaneXY(0, 0, 0), Radius=1, Angle=Domain(0, 3.141592654))  # -> Arc, Length
flow = Flow(
    Geometry=lined_up_blocks_brep,
    Base=line,
    Target=curve,
    ReverseBase=False,
    ReverseTarget=False,
    Stretch=True,
    Rigid=False)
