# Grasshopper definition parametric_designs.ghx (Grasshopper 1.0.8)

# ----
# Introduction
# This grasshopper file is used to make a brep that is created from two regular polygons that get lofted and can have an inset (hollow inside).
# The top and bottom polygons are created from the curves used for a circle that is then divided into polylines.
# 
# Rotation is available to create a “twist”.
# Bottom Polygon to Loft
centroidx = Slider(0, range=0..20)
centroidy = Slider(0, range=0..20)
radius = Slider(20, range=0..20)
polygon_sides = Slider(8, range=3..10)
bottom_centroid = ConstructPoint(XCoordinate=centroidx, YCoordinate=centroidy, ZCoordinate=0)
bottom_circle = CircleCNR(Center=bottom_centroid, Normal=Vector(0, 0, 1), Radius=radius)
divide_curve = DivideCurve(Curve=bottom_circle, Count=polygon_sides, Kinks=False)  # -> Points, Tangents, Parameters
rotation = Slider(14, range=0..360)
polyline = PolyLine(Vertices=divide_curve.Points, Closed=True)
rotate = Rotate(Geometry=polyline, Angle=rotation, Plane=PlaneXY(0, 0, 0))  # -> Geometry, Transform

# ----
# Top Polygon to Loft
centroidx_2 = Slider(0, range=0..20)
centroidy_2 = Slider(0, range=0..20)
height_z = Slider(17, range=0..50)
radius_2 = Slider(20, range=0..20)
polygon_sides_2 = Slider(3, range=3..10)
top_centroid = ConstructPoint(XCoordinate=centroidx_2, YCoordinate=centroidy_2, ZCoordinate=height_z)
top_circle = CircleCNR(Center=top_centroid, Normal=Vector(0, 0, 1), Radius=radius_2)
divide_curve_2 = DivideCurve(Curve=top_circle, Count=polygon_sides_2, Kinks=False)  # -> Points, Tangents, Parameters
rotation_2 = Slider(0, range=0..360)
polyline_2 = PolyLine(Vertices=divide_curve_2.Points, Closed=True)
rotate_2 = Rotate(Geometry=polyline_2, Angle=rotation_2, Plane=PlaneXY(0, 0, 0))  # -> Geometry, Transform

# ----
# Inset (Inner “Hole”)
# Inset Hole Height is the height from the bottom you don’t want the inset to be.
# For example, for a vase, you probably want to have some height for the base.
# Changing Bottom and Top Offset Distance will open and close the hole.
# Sometimes this distorts too heavily from twisting, make sure to look at the “Final Model” component closely.
inset_hole_height = Slider(4, range=0..50)
vector_xyz = VectorXYZ(XComponent=0, YComponent=0, ZComponent=inset_hole_height)  # -> Vector, Length
bottom_offset_distance = Slider(-7, range=-10..10)
create_base = Move(Geometry=rotate.Geometry, Motion=vector_xyz.Vector)  # -> Geometry, Transform
top_offset_distance = Slider(-1, range=-10..10)
# The Bottom and Top Offset Curves combine
# into the bottom curves to loft.
bottom_offset = OffsetCurve(Curve=create_base.Geometry, Distance=bottom_offset_distance, Corners=1)
top_offset = OffsetCurve(Curve=rotate_2.Geometry, Distance=top_offset_distance, Corners=1)

loft = Loft(
    Curves=[rotate_2.Geometry, rotate.Geometry],
    Options={Adjust=False, Closed=False, LoftEnds=0, LoftSimp=0, LoftType=0, Rebuild=10, Refit=0.01})
# The Bottom and Top Offset Curves combine
# into the bottom curves to loft. Cap holes is used to make sure the insets become holes.
loft_2 = Loft(
    Curves=[top_offset, bottom_offset],
    Options={Adjust=False, Closed=False, LoftEnds=0, LoftSimp=0, LoftType=0, Rebuild=10, Refit=0.01})

# ----
# This is the final model before slicing.
# Hide all components except this one if you want to see what the model looks like.
cap_holes = CapHoles(Brep=loft)
cap_holes_2 = CapHoles(Brep=loft_2)

solid_difference = SolidDifference(BrepsA=cap_holes, BrepsB=cap_holes_2)
bounding_box = BoundingBox(Content=solid_difference, Plane=PlaneXY(0, 0, 0))  # -> Box, Box_2
deconstruct_brep = DeconstructBrep(Brep=bounding_box.Box)  # -> Faces, Edges, Vertices
vector_xyz_2 = VectorXYZ(XComponent=0, YComponent=0, ZComponent=1)  # -> Vector, Length
list_item = ListItem(List=deconstruct_brep.Vertices, Index=0, Wrap=True)
# Slice height should correspond to the material thickness.  Units 1 = 1mm.
slice_height = Slider(4, range=0..20)
# Tweak slide spacing to make sure there’s enough space between the slides for printing.
contour = Contour(Shape=solid_difference, Point=list_item, Direction=vector_xyz_2.Vector, Distance=slice_height)
slice_spacing = Slider(43, range=0..100)
boundary_surfaces = BoundarySurfaces(Edges=contour)
brep = Brep(graft(boundary_surfaces))
deconstruct_brep_2 = DeconstructBrep(Brep=brep)  # -> flatten(Faces), Edges, Vertices
list_length = ListLength(List=deconstruct_brep_2.Faces)
series = Series(Start=0, Step=slice_spacing, Count=list_length)
unit_x = UnitX(Factor=series)  # -> graft(UnitVector)

# ----
# Move slices along the x axis so there is spacing and project to the xy plane to remove the z distance.
move = Move(Geometry=brep, Motion=unit_x)  # -> Geometry, Transform
project = Project(Geometry=move.Geometry, Plane=PlaneXY(0, 0, 0))  # -> Geometry, Transform

# ----
# Generate Numbers for Text on Surface for slices, and use isocurves to put text on the surface.
construct_point = ConstructPoint(XCoordinate=1, YCoordinate=1, ZCoordinate=0)

series_2 = Series(Start=0, Step=1, Count=list_length)
number_labels = Format(Format="{0}", Culture=127, Data0=series_2)  # -> graft(Text)

iso_curve = IsoCurve(Surface=project.Geometry, UVPoint=construct_point)  # -> UIsocurve, VIsocurve
text_on_surface = TextOnSurface(
    Text=number_labels,
    Font="Sans Bold:no Italic:no",
    Height=1,
    Depth=0.4,
    BaseLine=iso_curve.UIsocurve,
    BaseSurface=project.Geometry)
scale_factor = Slider(2, range=0..10)
brep_2 = Brep([project.Geometry, text_on_surface])
scale = Scale(Geometry=brep_2, Center=Point(0, 0, 0), Factor=scale_factor)  # -> Geometry, Transform
final_slices = Brep(scale.Geometry)
