# Grasshopper definition table.gh (Grasshopper 1.0.8)
# plug-ins: RhinoCodePluginGH

table_height = Slider(2, range=0..10)

leg_height = Slider(40, range=0..50)
# Legs from Boxes
lower_left = ConstructPoint(XCoordinate=40, YCoordinate=0, ZCoordinate=table_height)
upper_right = ConstructPoint(XCoordinate=50, YCoordinate=5, ZCoordinate=table_height)
upper_right_2 = ConstructPoint(XCoordinate=10, YCoordinate=5, ZCoordinate=table_height)
lower_left_2 = ConstructPoint(XCoordinate=0, YCoordinate=0, ZCoordinate=table_height)
vector_xyz = VectorXYZ(XComponent=-40, YComponent=0, ZComponent=leg_height)  # -> Vector, Length
front_leg = Box2Pt(PointA=lower_left, PointB=upper_right, Plane=PlaneXY(0, 0, 0))
vector_xyz_2 = VectorXYZ(XComponent=40, YComponent=0, ZComponent=leg_height)  # -> Vector, Length
back_leg = Box2Pt(PointA=lower_left_2, PointB=upper_right_2, Plane=PlaneXY(0, 0, 0))
extrude = Extrude(Base=front_leg, Direction=vector_xyz.Vector)
extrude_2 = Extrude(Base=back_leg, Direction=vector_xyz_2.Vector)
front_legs = Brep([extrude_2, extrude])

unit_z = UnitZ(Factor=table_height)
# Table Top
construct_point = ConstructPoint(XCoordinate=0, YCoordinate=0, ZCoordinate=0)
construct_point_2 = ConstructPoint(XCoordinate=50, YCoordinate=50, ZCoordinate=0)
table_top_box = Box2Pt(PointA=construct_point, PointB=construct_point_2, Plane=PlaneXY(0, 0, 0))
extrude_table_top = Extrude(Base=table_top_box, Direction=unit_z)

leg_distance = Slider(45, range=0..50)
unit_y = UnitY(Factor=leg_distance)

# ----
# Spirograph variables you can change
list_of_numbers_where_turtle_turns_left = Panel("[2, 3, 4, 5, 7]")
start_y = Slider(25, range=0..40)
angle = Slider(115, range=0..360)
side_length = Slider(2, range=0..50)
start_x = Slider(25, range=0..40)
iterations = Slider(10, range=0..20)
python_3_script = Python3Script(x=start_x, y=start_y, angle=angle, side=side_length, num_iter=iterations, list=list_of_numbers_where_turtle_turns_left)  # -> out, a
# ---------- python_3_script: Python ----------
"""Grasshopper Script"""
import rhinoscriptsyntax as rs
import math
import Rhino.Geometry as rg

"""A basic turtle class that assumes we're on the z=0 XY plane"""
class Turtle:
    def __init__(self, x, y, angle):
        self.x = x;
        self.y = y;
        self.angle = angle # in degrees
        self.pen_down = True
        self.path = []
        self.path.append(rg.Point3d(self.x, self.y, 0))

    def forward(self, distance):
        x = self.x + distance * math.cos(math.radians(self.angle))
        y = self.y + distance * math.sin(math.radians(self.angle))

        if self.pen_down is True:
            self.path.append(rg.Point3d(x, y, 0))

        self.x = x
        self.y = y

    def back(self, distance):
        # Just go forward the negative distance
        self.forward(-distance)

    def right(self, angle):
        self.angle -= angle

    def left(self, angle):
        self.angle += angle

    def pen_up(self):
        self.pen_down = False

    def pendown(self):
        self.pen_down = True
        self.path.append(rg.Point3d(self.x, self.y, 0))

    def get_polyline(self):
        return rg.Polyline(self.path)

# Gspiro technique adapted from Turtle Geometry: The Computer as a Medium for Exploring Mathematics pg. 38
def gspiro(turtle, side, angle, max_iterations, turn_list):
    """ Main gspiro routine """
    for _ in range(max_iterations):
        subgspiro(turtle, side, angle, max_iterations, turn_list)

def subgspiro(turtle, side, angle, max_iterations, turns_list):
    """ Subroutine that runs """
    for n in range(1, max_iterations):
        turtle.forward(side * n)
        if n in turn_list:
            turtle.left(angle)
        else:
            turtle.right(angle)

# Parse our input list into a new list
string_list = list
print(string_list)
string_elements = string_list.strip("[]").split(", ")
turn_list = [int(e) for e in string_elements]

iterations = int(num_iter)

# Run through our turtle script using our inputs for where the start should be
turtle = Turtle(x, y, 0) # Start at input given for x/y on the xy plane
gspiro(turtle, side, angle, iterations, turn_list)

# Output the polylines generated
a = turtle.get_polyline()
# ---------- end python_3_script ----------
boundary_surfaces = BoundarySurfaces(Edges=python_3_script.a)
unit_z_2 = UnitZ(Factor=table_height)
# Turtle Geometry with Spirolaterals
area = Area(Geometry=table_top_box)  # -> Area, Centroid
bounding_box = BoundingBox(Content=boundary_surfaces, Plane=PlaneXY(0, 0, 0))  # -> Box, Box_2
area_2 = Area(Geometry=bounding_box.Box)  # -> Area, Centroid
extrude_3 = Extrude(Base=boundary_surfaces, Direction=unit_z_2)
vector_2pt = Vector2Pt(PointA=area_2.Centroid, PointB=area.Centroid, Unitize=False)  # -> Vector, Length
move = Move(Geometry=extrude_3, Motion=vector_2pt.Vector)  # -> Geometry, Transform
moved_spirograph = Brep(move.Geometry)

back_legs = Move(Geometry=front_legs, Motion=unit_y)  # -> Geometry, Transform
legs_brep = Brep([back_legs.Geometry, front_legs])
table_solid_diff = SolidDifference(BrepsA=extrude_table_top, BrepsB=moved_spirograph)
final_brep = Brep([legs_brep, table_solid_diff])
